# Dynamo graph Batch_Link_Models.dyn "Link_AR_ST" (Dynamo 2.18.1.5096)

file_path = Filename("Z:\Mostafa\Dynamo Script\Link_AR_ST\Links_paths.csv")  # graph input
linking_node = Python(IN[0]=file_path)  # CPython3
# ---------- linking_node.python (135 lines) ----------
import clr
import csv
import os  # To extract the file name and path
clr.AddReference("RevitServices")
from RevitServices.Persistence import DocumentManager
from RevitServices.Transactions import TransactionManager

clr.AddReference("RevitAPI")
import Autodesk.Revit.DB as DB

# Input - CSV file path containing Revit model paths
csv_file_path = IN[0]

# Output list for success or failure messages
output = []

# List to store Revit model paths from the CSV file
file_paths = []

# 1. Read CSV file and extract paths
try:
    with open(csv_file_path, 'r') as file:
        reader = csv.reader(file)
        for row in reader:
            # Each row in the CSV file is treated as a path
            if row:  # Check if the row is not empty
                file_paths.append(row[0].strip())  # Strip any extra whitespace
except Exception as e:
    output.append(f"Failed to read CSV file: {str(e)}")
    OUT = output  # Set output and exit early if there's an error

# If no valid paths are found in the CSV, exit early
if not file_paths:
    output.append("No valid paths found in the CSV file.")
    OUT = output
else:
    # Get the current document
    doc = DocumentManager.Instance.CurrentDBDocument

    # Start transaction for linking the models
    TransactionManager.Instance.EnsureInTransaction(doc)

    # Loop through each file path
    for path in file_paths:
        try:
            # Extract the file name from the path
            file_name = os.path.basename(path)  # Example: "model_File_name.rvt"
            
            # Verify if the path is a valid file path (ends with .rvt)
            if not path.endswith(".rvt"):
                output.append(f"{file_name} is not a Revit model.")
                continue
            
            # Create a ModelPath from the file path
            model_path = DB.ModelPathUtils.ConvertUserVisiblePathToModelPath(path)
            
            # Check if the model is already linked by checking RevitLinkType elements
            already_linked = False
            link_unloaded = False
            link_no_instance = False
            
            # Check for already linked files and status of each link
            for link in DB.FilteredElementCollector(doc).OfClass(DB.RevitLinkType):
                # Get the external file reference
                external_ref = link.GetExternalFileReference()
                if external_ref is not None:
                    linked_model_path = DB.ModelPathUtils.ConvertModelPathToUserVisiblePath(external_ref.GetAbsolutePath()).lower()
                    
                    # Compare the linked path to the current path from CSV (case insensitive)
                    if linked_model_path == path.lower():
                        already_linked = True

                        # First check: Is the link unloaded?
                        file_status = external_ref.GetLinkedFileStatus()
                        if file_status == DB.LinkedFileStatus.Unloaded:
                            link_unloaded = True
                            output.append(f"Link: {file_name} is linked but unloaded.")
                        
                        # Second check: Does the link have no instances in the model?
                        link_instances = DB.FilteredElementCollector(doc).OfClass(DB.RevitLinkInstance).ToElements()
                        instance_exists = any(instance.GetTypeId() == link.Id for instance in link_instances)
                        
                        if not instance_exists:
                            link_no_instance = True
                            output.append(f"Link: {file_name} is linked but has no instances, Remove it before linking it again.")
                        
                        break  # No need to keep checking other links if match is found
            
            if already_linked:
                if link_unloaded or link_no_instance:
                    # We have already logged the unloaded and no-instance cases
                    continue
                else:
                    output.append(f"{file_name} already linked before.")
                    continue
            
            # Linking the model if not already linked or flagged as unloaded/no instance
            options = DB.RevitLinkOptions(False)  # False means we don't want to link worksets
            link_type = DB.RevitLinkType.Create(doc, model_path, options)
            DB.RevitLinkInstance.Create(doc, link_type.ElementId)
            output.append(f"{file_name} linked successfully.")
        
        except Exception as e:
            # Handle specific Revit API errors, especially for "already linked" cases
            if "document already contains a linked model at path" in str(e):
                output.append(f"{file_name} already linked before.")
            else:
                # Catch any other errors during the linking process
                output.append(f"Failed to link {file_name}: {str(e)}")
            continue

    # Commit the transaction
    TransactionManager.Instance.TransactionTaskDone()

    # 2. Write the log to a txt file with a fixed name "Link_log.txt"
    try:
        # Get the directory of the CSV file
        csv_directory = os.path.dirname(csv_file_path)
        # Create a log file name "Link_log.txt"
        log_file_name = "Link_log.txt"
        log_file_path = os.path.join(csv_directory, log_file_name)
        
        # Write the output log to the file
        with open(log_file_path, 'w') as log_file:
            for message in output:
                log_file.write(message + "\n")
        
        # Notify that the log file has been created
        output.append(f"Log file created: {log_file_path}")
    
    except Exception as e:
        output.append(f"Failed to write log file: {str(e)}")

# Output the results in Dynamo and also create the log file
OUT = output
# ----------------------------------------
watch = Watch(linking_node)  # graph output
